# Grasshopper definition parse.gh (Grasshopper 1.0.7)

panel = Panel("""Nube Puntos
Análisis Nube Puntos
Mesh Tridimensional
Datos GIS
Datos Planimétricos
Información RT
Diseño Proyecto Espacial
Desarrollo de Marca
Automatizaciones y Transferencias
Iteraciones Diseño
Imágenes y Vídeos
Package and Online Distribution""")
entwine = Entwine(Branch00="Small", Branch02="Small", Branch03="Small", FlattenInputs=True)
entwine_2 = Entwine(Branch00="Point cloud", Branch02="Point cloud", FlattenInputs=True)
panel_2 = Panel("Geographical Information System")
entwine_3 = Entwine(
    Branch00="Medium",
    Branch01="Medium",
    Branch02="Medium",
    Branch04="Medium",
    Branch06="Medium",
    Branch010="Medium",
    Branch011="Medium",
    FlattenInputs=True)
entwine_4 = Entwine(
    Branch00=panel_2,
    Branch01=panel_2,
    Branch02=panel_2,
    Branch04=panel_2,
    Branch06=panel_2,
    Branch011=panel_2,
    FlattenInputs=True)
panel_3 = Panel("Building Information Model")
entwine_5 = Entwine(
    Branch01=panel_3,
    Branch02=panel_3,
    Branch04=panel_3,
    Branch08=panel_3,
    Branch09=panel_3,
    Branch010=panel_3,
    Branch011=panel_3,
    FlattenInputs=True)
entwine_6 = Entwine(
    Branch00="Large",
    Branch01="Large",
    Branch02="Large",
    Branch04="Large",
    Branch05="Large",
    Branch06="Large",
    Branch07="Large",
    Branch08="Large",
    Branch09="Large",
    Branch010="Large",
    Branch011="Large",
    FlattenInputs=True)
merge = Merge(Data1=entwine, Data2=entwine_3, Data3=entwine_6)
entwine_7 = Entwine(
    Branch01="Virtual Reallity",
    Branch02="Virtual Reallity",
    Branch03="Virtual Reallity",
    Branch04="Virtual Reallity",
    Branch05="Virtual Reallity",
    Branch06="Virtual Reallity",
    Branch07="Virtual Reallity",
    Branch08="Virtual Reallity",
    Branch09="Virtual Reallity",
    Branch010="Virtual Reallity",
    Branch011="Virtual Reallity",
    FlattenInputs=True)
merge_2 = Merge(Data1=entwine_2, Data2=entwine_4, Data3=entwine_5, Data4=entwine_7)
tstat = TreeStatistics(Tree=merge_2)  # -> Paths, Length, Count
tstat_2 = TreeStatistics(Tree=merge)  # -> Paths, Length, Count
tstat_3 = TreeStatistics(Tree=merge_2)  # -> Paths, Length, Count
dup = DuplicateData(Data=graft(panel), Number=graft(tstat.Length), Order=True)
dup_2 = DuplicateData(Data=merge_2, Number=graft(tstat_2.Length), Order=True)  # -> simplify(Data)
dup_3 = DuplicateData(Data=dup, Number=graft(tstat_2.Length), Order=True)  # -> simplify(Data)
dup_4 = DuplicateData(Data=merge, Number=graft(tstat_3.Length), Order=True)  # -> simplify(Data)
panel_4 = Panel(dup)
panel_5 = Panel(dup_3)
panel_6 = Panel(merge_2)
panel_7 = Panel(dup_2)
panel_8 = Panel(dup_4)
concat = Concatenate(FragmentA="<td>", FragmentC=panel_7, FragmentB="</td>")
concat_2 = Concatenate(FragmentA="<td>", FragmentC=panel_8, FragmentB="</td>")
concat_3 = Concatenate(FragmentA="<td>", FragmentC=panel_5, FragmentB="</td>")
merge_3 = Merge(Data1=graft(concat_3), Data2=graft(concat), Data3=graft(concat_2))
join = TextJoin(Text=merge_3)
cset = CreateSet(List=flatten(join))  # -> Set, Map
concat_4 = Concatenate(FragmentA="<tr>", FragmentC=join, FragmentB="</tr>")
join_2 = TextJoin(Text=flatten(concat_4))
panel_9 = Panel(join_2)
